# Grasshopper definition cabinet2.gh (Grasshopper 0.9.76)
# plug-ins: Python Interpreter, Human, Wombat, Telepathy

panel = Panel("""48
18
18""")
bang = ExplodeTree(Data=simplify(graft(panel)))  # -> Branch0, Branch1, Branch2
panel_2 = Panel("6")
list = ValueList({"None": 0, "Doors": 1, "Drawers": 2}, selected="Doors")
box = DomainBox(Base=PlaneXY(0, 0, 0), X=Slider(54, range=12..60), Y=Slider(18, range=12..60), Z=Slider(18, range=12..60))
list_2 = ValueList({"1/4": .25, "1/2": .5, "3/4": .75, "6mm": .236, "12mm": .472}, selected="3/4")
list_3 = ValueList({"1/4": .25, "1/2": .5, "3/4": .75, "6mm": .236, "12mm": .472}, selected="1/4")
list_4 = ValueList({"1/4": .25, "3/8": .375, "1/2": .5, "3/4": .75, "6mm": .236, "12mm": .472}, selected="1/2")
list_5 = ValueList({"1/4": .25, "1/2": .5, "3/4": .75, "6mm": .236, "12mm": .472}, selected="1/4")
list_6 = ValueList({"1/4": .25, "3/8": .375, "1/2": .5, "3/4": .75, "6mm": .236, "12mm": .472}, selected="3/4")
list_7 = ValueList({"1/4": .25, "1/2": .5, "3/4": .75, "6mm": .236, "12mm": .472}, selected="3/4")
list_8 = ValueList({"1/4": .25, "3/8": .375, "1/2": .5, "3/4": .75, "6mm": .236, "12mm": .472}, selected="3/8")
list_9 = ValueList({"1/4": .25, "3/8": .375, "1/2": .5, "3/4": .75, "6mm": .236, "12mm": .472}, selected="1/2")
python = PythonScript(
    b=box,
    caseThickness=list_2,
    tenonThickness=list_3,
    mortiseDepth=list_4,
    backThickness=list_6,
    divisions=Slider(2, range=0..3),
    adjustableShelves=Toggle(True),
    front=list,
    bake=Button())  # -> out, top, bottom, bottomAttr, left, leftAttr, right, rightAttr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; inputs b: Brep, divisions: Int32, adjustableShelves: Boolean, bake: Boolean
# ---------- python: Python ----------
import Rhino as r
import Rhino.Geometry.Point3d as pt
import Rhino.Geometry.Curve as crv
import Rhino.Geometry.Vector3d as v
import Rhino.Geometry.Plane as plane
import Rhino.Geometry.Transform as xform
import Rhino.DocObjects as rd
import System

edges = b.Curves3D

bottomEdges = [edges[0],edges[1],edges[2],edges[3]]
topEdges = [edges[4],edges[5],edges[6],edges[7]]
leftEdges = [edges[3],edges[8],edges[7],edges[11]]
rightEdges = [edges[1],edges[10],edges[5],edges[9]]
backEdges = [edges[2],edges[10],edges[6],edges[11]]
frontEdges = [edges[0],edges[9],edges[4],edges[8]]
divTs = crv.DivideByCount(edges[0], divisions+1, False)

def makeLayers():
    #Set up layers & attributes
    layerTable = r.RhinoDoc.ActiveDoc.Layers
    layers = ['quarterDrill', 'quarterMortise', 'centerDrill', 'halfRebate', 'halfTenon','cutOut', 'hingeMortise']
    for layer in layers:
        layerTable.Add(layer, System.Drawing.Color.Black)
        globals()[layer+'Attr'] = rd.ObjectAttributes()
        globals()[layer+'Attr'].LayerIndex = layerTable.Find(layer, True)

def flattenLists(lists):
    newList = []
    for oldList in lists:
        if type(oldList) == list:
            for item in oldList:
                newList.append(item)
        else:
            newList.append(oldList)
    return newList

def makeDoor(point, width, height, middle):
    point.Transform(xform.Translation(0,-caseThickness,0))
    pt0 = point
    pt1 = pt.Add(pt0,v(width-.125,0,0))
    pt2 = pt.Add(pt1,v(0,0,height))
    pt3 = pt.Add(pt2,v(-width+.125,0,0))
    pt4 = pt.Add(pt0,v(.846,caseThickness-.472,2))
    pt4Attr = hingeMortiseAttr.Duplicate()
    pt4a = pt.Add(pt4,v(.354,+.372,.886))
    pt4aAttr = centerDrillAttr.Duplicate()
    pt4b = pt.Add(pt4,v(.354,+.372,-.886))
    pt4bAttr = centerDrillAttr.Duplicate()
    pt5 = pt.Add(pt3,v(.846,caseThickness-.472,-2))
    pt5Attr = hingeMortiseAttr.Duplicate()
    pt5a = pt.Add(pt5,v(.354,+.372,.886))
    pt5aAttr = centerDrillAttr.Duplicate()
    pt5b = pt.Add(pt5,v(.354,+.372,-.886))
    pt5bAttr = centerDrillAttr.Duplicate()
    outline = r.Geometry.PolylineCurve([pt0,pt1,pt2,pt3, pt0])
    outlineAttr = cutOutAttr.Duplicate()
    geoList = [pt4, pt4a, pt4b, pt5, pt5a, pt5b,outline]
    attrList = [pt4Attr, pt4aAttr, pt4bAttr, pt5Attr, pt5aAttr, pt5bAttr,outlineAttr]
    return geoList, attrList

def makeDoors():
    doorGeoList = []
    doorAttrList = []
    tList = edges[0].DivideByCount(divisions+1, True)
    height = edges[8].GetLength()
    if height > 40:
        middle = True
    else:
        middle = False
    for i in range(len(tList)-1):
        groupName = 'Door'+str(i)
        r.RhinoDoc.ActiveDoc.Groups.Add(groupName)
        groupIndex = r.RhinoDoc.ActiveDoc.Groups.Find(groupName, True)
        width = tList[i+1]-tList[i]
        point = edges[0].PointAt(tList[i])
        geoList, attrList = makeDoor(point, width, height, middle)
        for attr in attrList:
            attr.AddToGroup(groupIndex)
        doorGeoList.append(flattenLists(geoList))
        doorAttrList.append(flattenLists(attrList))
    return doorGeoList, doorAttrList

def hingeDrillSide(edge, middle):
    t0 = edge.Domain[0]
    t1 = edge.Domain[1]
    xIn = r.Geometry.Transform.Translation(0,1.457,0)
    pt1 = edge.PointAt(t0 + 2)
    pt2 = edge.PointAt(t1 - 2)
    pt1a = pt.Add(pt1,v(0,0,.63))
    pt1b = pt.Add(pt1,v(0,0,-.63))
    pt2a = pt.Add(pt2,v(0,0,.63))
    pt2b = pt.Add(pt2,v(0,0,-.63))
    drillPts = [pt1a, pt1b, pt2a, pt2b]
    if middle is True:
        pt3 = edge.PointAt(edge.Domain.Mid)
        drillPts.append(pt3)
    newPts = []
    for point in xIn.TransformList(drillPts):
        newPts.append(point)
    return newPts

def makeBottom(edgeList, dividers, direction):
    #direction: 1 for bottom, -1 for top
    if direction < 0:
        groupName = 'Bottom'
    else:
        groupName = 'Top'
    r.RhinoDoc.ActiveDoc.Groups.Add(groupName)
    groupIndex = r.RhinoDoc.ActiveDoc.Groups.Find(groupName,True)
    geoList = []
    attrList = []
    t0 = edgeList[0].Domain[0]
    t1 = edgeList[0].Domain[1]
    vU = r.Geometry.Vector3d(0,backThickness+.5,0)
    vD = r.Geometry.Vector3d(0,-backThickness-.5,0)
    vL = r.Geometry.Vector3d(-mortiseDepth,0,0)
    vR = r.Geometry.Vector3d(mortiseDepth,0,0)
    vZ = r.Geometry.Vector3d(0,0,tenonThickness-.01)
    ptA0 = edgeList[0].PointAt(t0+caseThickness)
    ptA1 = pt.Add(ptA0,vU)
    ptA2 = pt.Add(ptA1,vL)
    ptA3 = pt.Add(ptA0,vZ)
    ptB0 = edgeList[0].PointAt(t1-caseThickness)
    ptB1 = pt.Add(ptB0,vU)
    ptB2 = pt.Add(ptB1,vR)
    ptB3 = pt.Add(ptB0,vZ)
    ptC0 = edgeList[2].PointAt(t0+caseThickness)
    ptC1 = pt.Add(ptC0,vD)
    ptC2 = pt.Add(ptC1,vR)
    ptC3 = pt.Add(ptC0,vZ)
    ptD0 = edgeList[2].PointAt(t1-caseThickness)
    ptD1 = pt.Add(ptD0,vD)
    ptD2 = pt.Add(ptD1,vL)
    ptD3 = pt.Add(ptD0,vZ)
    for t in divTs:
        divPtA = edgeList[0].PointAt(t-(direction*caseThickness/2))
        divPtB = edgeList[2].PointAt(edgeList[2].ClosestPoint(divPtA)[1])
        divPtA = pt.Add(divPtA,vU)
        divPtB = pt.Add(divPtB,vD)
        mortise = r.Geometry.PolylineCurve([divPtA,divPtB])
        geoList.append(mortise)
        attrList.append(quarterMortiseAttr.Duplicate())
    tenonRight = r.Geometry.PolylineCurve([ptB3,ptC3])
    geoList.append(tenonRight)
    attrList.append(halfTenonAttr.Duplicate())
    tenonLeft = r.Geometry.PolylineCurve([ptD3,ptA3])
    geoList.append(tenonLeft)
    attrList.append(halfTenonAttr.Duplicate())
    bottomPts = [ptA0,ptB0,ptB1,ptB2,ptC2,ptC1,ptC0,ptD0,ptD1,ptD2,ptA2,ptA1,ptA0]
    bottomOutline = r.Geometry.PolylineCurve(bottomPts)
    geoList.append(bottomOutline)
    attrList.append(cutOutAttr.Duplicate())
    for attr in attrList:
        attr.AddToGroup(groupIndex)
    return geoList, attrList

def makeSide(edgeList, direction):
    #direction: 1 for left side, -1 for right side
    geoList = []
    attrList = []
    t0 = edgeList[0].Domain[0]
    t1 = edgeList[0].Domain[1]
    vI = r.Geometry.Vector3d(direction*(caseThickness-mortiseDepth),0,0) #inside
    vIR = r.Geometry.Vector3d(direction*.25,0,0) #inside Rabbet
    vICenter = v(direction*caseThickness-.1,0,0)
    vU = r.Geometry.Vector3d(0,0,caseThickness-tenonThickness)
    vD = r.Geometry.Vector3d(0,0,tenonThickness-caseThickness)
    ptA = edgeList[0].PointAt(t0+backThickness+.5)
    ptA = pt.Add(ptA,vU)
    ptA = pt.Add(ptA,vI)
    ptA1 = edgeList[0].PointAt(t1-backThickness)
    ptA1 = pt.Add(ptA1,vU)
    ptA1 = pt.Add(ptA1,vIR)
    ptB = edgeList[0].PointAt(t1-backThickness-.5)
    ptB = pt.Add(ptB,vU)
    ptB = pt.Add(ptB,vI)
    ptB1 = edgeList[0].PointAt(t0+backThickness)
    ptB1 = pt.Add(ptB1,vU)
    ptB1 = pt.Add(ptB1,vIR)
    ptC = edgeList[2].PointAt(t0+backThickness+.5)
    ptC = pt.Add(ptC,vD)
    ptC = pt.Add(ptC,vI)
    ptC1 = edgeList[2].PointAt(t0+backThickness)
    ptC1 = pt.Add(ptC1,vD)
    ptC1 = pt.Add(ptC1,vIR)
    ptD = edgeList[2].PointAt(t1-backThickness-.5)
    ptD = pt.Add(ptD,vD)
    ptD = pt.Add(ptD,vI)
    ptD1 = edgeList[2].PointAt(t1-backThickness)
    ptD1 = pt.Add(ptD1,vD)
    ptD1 = pt.Add(ptD1,vIR)
    mortiseBottom = r.Geometry.PolylineCurve([ptA,ptB])
    geoList.append(mortiseBottom)
    attrList.append(quarterMortiseAttr.Duplicate())
    mortiseTop = r.Geometry.PolylineCurve([ptD,ptC])
    geoList.append(mortiseTop)
    attrList.append(quarterMortiseAttr.Duplicate())
    pegPts = []
    xI = xform.Translation(vIR)
    xIC = xform.Translation(vICenter)
    if adjustableShelves:
        pegPts = pegHoles(edgeList)
        pegPts = flattenLists(xI.TransformList(pegPts))
        for point in pegPts:
            geoList.append(point)
            attrList.append(quarterDrillAttr.Duplicate())
    if direction < 0:
        groupName = 'RightSide'
        hingePts = hingeDrillSide(edgeList[3],False)
        hingePts = flattenLists(xIC.TransformList(hingePts))
        backRabbet = r.Geometry.PolylineCurve([ptD1,ptA1])
    else:
        groupName = 'LeftSide'
        hingePts = hingeDrillSide(edgeList[1],False)
        hingePts = flattenLists(xIC.TransformList(hingePts))
        backRabbet = r.Geometry.PolylineCurve([ptB1,ptC1])
    sideOutline = r.Geometry.Curve.JoinCurves(edgeList)[0]
    if hingePts is not None:
        for point in hingePts:
            geoList.append(point)
            attrList.append(centerDrillAttr.Duplicate())
    geoList.append(backRabbet)
    attrList.append(halfRebateAttr.Duplicate())
    geoList.append(sideOutline)
    attrList.append(cutOutAttr.Duplicate())
    r.RhinoDoc.ActiveDoc.Groups.Add(groupName)
    groupIndex = r.RhinoDoc.ActiveDoc.Groups.Find(groupName, True)
    for attr in attrList:
        attr.AddToGroup(groupIndex)
    return geoList, attrList

def makeBack(edgeList):
    r.RhinoDoc.ActiveDoc.Groups.Add('Back')
    groupIndex = r.RhinoDoc.ActiveDoc.Groups.Find('Back', False)
    geoList = []
    attrList = []
    x1 = xform.Translation(0,0,3)
    bottomDivs = edgeList[0].DivideByCount(divisions*2+2, False)
    for i in range(len(bottomDivs)):
        t = bottomDivs[i]
        if i%2 == 0:
            point = edgeList[0].PointAt(t)
            point.Transform(x1)
            geoList.append(point)
            attrList.append(hingeMortiseAttr.Duplicate())
    t0 = edgeList[0].Domain[0]
    t1 = edgeList[0].Domain[1]
    vU = r.Geometry.Vector3d(0,0,caseThickness)
    vD = r.Geometry.Vector3d(0,0,-caseThickness)
    ptA = edgeList[0].PointAt(t0+.25)
    ptA = pt.Add(ptA,vU)
    ptB = edgeList[0].PointAt(t1-.25)
    ptB = pt.Add(ptB,vU)
    ptC = edgeList[2].PointAt(t1-.25)
    ptC = pt.Add(ptC,vD)
    ptD = edgeList[2].PointAt(t0+.25)
    ptD = pt.Add(ptD,vD)
    backOutline = r.Geometry.PolylineCurve([ptA,ptB,ptC,ptD,ptA])
    geoList.append(backOutline)
    attrList.append(cutOutAttr.Duplicate())
    for attr in attrList:
        attr.AddToGroup(groupIndex)
    return geoList, attrList
    
def makeDivider(edgeList):
    geoList = []
    attrList = []
    t0 = edgeList[0].Domain[0]
    t1 = edgeList[0].Domain[1]
    vR = r.Geometry.Vector3d(0,.5,0) 
    vRR = r.Geometry.Vector3d(0,backThickness+.5,0)
    vL = r.Geometry.Vector3d(0,-.5,0) 
    vLL = r.Geometry.Vector3d(0,-.5,0)  
    vU = r.Geometry.Vector3d(0,0,.25)
    vUU = r.Geometry.Vector3d(0,0,.5)
    vD = r.Geometry.Vector3d(0,0,-.25)
    vDD = r.Geometry.Vector3d(0,0,-.5)
    vY = v(tenonThickness-.01,0,0)
    ptA = edgeList[0].PointAt(t0+backThickness+.5)
    ptA0 = pt.Add(ptA,vU)
    ptA1 = pt.Add(ptA0,vUU)
    ptA2 = pt.Add(ptA1,vR)
    ptA3 = pt.Add(ptA2, vY)
    ptB = edgeList[2].PointAt(t0+backThickness+.5)
    ptB2 = pt.Add(ptB,vD)
    ptB1 = pt.Add(ptB2,vDD)
    ptB0 = pt.Add(ptB1, vR)
    ptB3 = pt.Add(ptB0, vY)
    ptC = edgeList[2].PointAt(t1)
    ptC2 = pt.Add(ptC,vDD)
    ptC2 = pt.Add(ptC2, vD)
    ptC1 = pt.Add(ptC2, vRR)
    ptC0 = pt.Add(ptC1, vUU)
    ptC3 = pt.Add(ptC2, vY)
    ptD = edgeList[0].PointAt(t1)
    ptD0 = pt.Add(ptD, vUU)
    ptD0 = pt.Add(ptD0,vU)
    ptD1 = pt.Add(ptD0, vRR)
    ptD2 = pt.Add(ptD1, vDD)
    ptD3 = pt.Add(ptD0, vY)
    tenonBottom = r.Geometry.PolylineCurve([ptD3, ptA3])
    tenonTop = r.Geometry.PolylineCurve([ptB3, ptC3])
    dividerOutline = r.Geometry.PolylineCurve([ptA0,ptA1,ptA2,ptB0,ptB1,ptB2,ptC0, ptC1, ptC2, ptD0, ptD1, ptD2, ptA0])
    hingePts = hingeDrillSide(edgeList[1],False)
    for point in hingePts:
        geoList.append(point)
        attrList.append(centerDrillAttr.Duplicate())
    if adjustableShelves:
        pegPts = pegHoles(edgeList)
        for point in pegPts:
            geoList.append(point)
            attrList.append(quarterDrillAttr.Duplicate())
    geoList.append(tenonBottom)
    attrList.append(halfTenonAttr.Duplicate())
    geoList.append(tenonTop)
    attrList.append(halfTenonAttr.Duplicate())
    geoList.append(dividerOutline)
    attrList.append(cutOutAttr.Duplicate())
    return geoList, attrList

def pegHoles(edgeList):
    t0 = edgeList[1].Domain[0]
    t1 = edgeList[1].Domain[1]
    t2 = edgeList[0].Domain[0]
    t3 = edgeList[0].Domain[1]
    pt0 = edgeList[1].PointAt(t0+2)
    pt1 = edgeList[1].PointAt(t1-2)
    plane0 = plane(edgeList[0].PointAtStart, v.YAxis)
    plane1 = plane(edgeList[0].PointAt(t2+2), v.YAxis)
    plane2 = plane(edgeList[0].PointAt(t3-2), v.YAxis)
    x1 = r.Geometry.Transform.PlaneToPlane(plane1,plane0)
    x2 = r.Geometry.Transform.PlaneToPlane(plane2, plane1)
    divLine = r.Geometry.PolylineCurve([pt0,pt1])
    tArray = divLine.DivideByLength(2, False)
    ptArray = []
    for t in tArray:
        ptArray.append(divLine.PointAt(t))
    frontPts = x1.TransformList(ptArray)
    backPts = x2.TransformList(frontPts)
    pegPts = []
    for point in frontPts:
        pegPts.append(point)
    for point in backPts:
        pegPts.append(point)
    return pegPts

dividers = []
dividersAttr = []

for i in range(len(divTs)):
    groupName = 'Divider'+str(i)
    r.RhinoDoc.ActiveDoc.Groups.Add(groupName)
    groupIndex = r.RhinoDoc.ActiveDoc.Groups.Find(groupName, True)
    t = divTs[i]
    plane0 = plane(edges[0].PointAtStart, v.YAxis)
    plane1 = plane(edges[0].PointAt(t), v.YAxis)
    x = r.Geometry.Transform.PlaneToPlane(plane0, plane1)
    geoList, attrList = makeDivider(leftEdges)
    for j in range(len(geoList)):
        geoList[j].Transform(x)
        dividers.append(geoList[j])
        attrList[j].AddToGroup(groupIndex)
        dividersAttr.append(attrList[j])

makeLayers()

bottom = flattenLists(makeBottom(bottomEdges, divisions, 1)[0])
bottomAttr = flattenLists(makeBottom(bottomEdges, divisions, 1)[1])
top = flattenLists(makeBottom(topEdges, divisions, -1)[0])
topAttr = flattenLists(makeBottom(topEdges, divisions, -1)[1])
left = flattenLists(makeSide(leftEdges, 1)[0])
leftAttr = flattenLists(makeSide(leftEdges, 1)[1])
right = flattenLists(makeSide(rightEdges, -1)[0])
rightAttr = flattenLists(makeSide(rightEdges, -1)[1])
back, backAttr = makeBack(backEdges)
front = flattenLists(makeDoors()[0])
frontAttr = flattenLists(makeDoors()[1])

bakeGeoLists = [bottom, top, left, right, back, front, dividers]
bakeAttrLists = [bottomAttr, topAttr, leftAttr, rightAttr, backAttr, frontAttr, dividersAttr]

if bake:
    print "Baking..."
    for i in range(len(bakeGeoLists)):
        for j in range(len(bakeGeoLists[i])):
            object = bakeGeoLists[i][j]
            attr = bakeAttrLists[i][j]
            if type(bakeGeoLists[i][j]) == r.Geometry.Point3d:
                r.RhinoDoc.ActiveDoc.Objects.AddPoint(object, attr)
            if isinstance(object, r.Geometry.Curve):
                r.RhinoDoc.ActiveDoc.Objects.AddCurve(object,attr)
# ---------- end python ----------
mat_tenonthickness = RemoteSender(list_8)
mat_toprailwidth = RemoteSender("6")
mat_shoulderwidth = RemoteSender("1")
mat_casethickness = RemoteSender(list_7)
mat_tenondepth = RemoteSender(list_9)
mat_backthickness = RemoteSender(list_5)
col = Colour(RGBA(150, 0, 0, 111))
geo = Geometry(python.front)
crvdir = CurveDirectionDisplay(Curves=geo, Color=col, Size=20)
bake = BakeGeometry(Bake=Button(), Geometry=python.bottom, Attributes=python.bottomAttr, DeleteOldBakes=False, PreserveTrees=False)
boxfaces = PythonScript()  # -> out, top, bottom, front, back, left, right, a; inputs box: Brep
# ---------- boxfaces: Python ----------
import Rhino as r
a = []

for face in box.Faces:
    #normal = face.TryGetPlane(0)[1].Normal
    u = face.Domain(0)
    v = face.Domain(1)
    normal = face.NormalAt(u[0],v[0])
    a.append(face.DuplicateFace(face))
    if (normal.VectorAngle(normal,(r.Geometry.Vector3d(0,-1,0)))==0):
            front = face.DuplicateFace(face)
    elif (normal.VectorAngle(normal,(r.Geometry.Vector3d(1,0,0)))==0):
            right = face.DuplicateFace(face)
    elif (normal.VectorAngle(normal,(r.Geometry.Vector3d(0,1,0)))==0):
            back = face.DuplicateFace(face)
    elif (normal.VectorAngle(normal,(r.Geometry.Vector3d(-1,0,0)))==0):
            left = face.DuplicateFace(face)
    elif (normal.VectorAngle(normal,(r.Geometry.Vector3d(0,0,-1)))==0):
            bottom = face.DuplicateFace(face)
    elif (normal.VectorAngle(normal,(r.Geometry.Vector3d(0,0,1)))==0):
            top = face.DuplicateFace(face)
    else:
        print("Non-orthoganal face detected")
        print(normal.VectorAngle(normal,(r.Geometry.Vector3d(-1,0,0))))
# ---------- end boxfaces ----------
